# Grasshopper definition Fbx_Extractor_Geometry_Transformer.gh (Grasshopper 0.9.76)
# plug-ins: Python Interpreter, LunchBox

brep = Brep([<brep referenced from the Rhino model> x69])
path = FilePath("C:\Users\User\Downloads\test (1).csv")
file = ReadFile(File=path, PerLineParse=True)
csv = ReadCSV(CSVString=file, Delimiter=",")  # -> Headers, Values
panel = Panel(csv.Values)
python_nik_s_obj_file_saver = PythonScript(Brep=brep)  # -> out; inputs Brep: list of Brep
# ---------- python_nik_s_obj_file_saver: Python ----------
import rhinoscriptsyntax as rs
import Rhino
import os

print "Brep size : " + str(len(Brep))
for q in range (0,len(Brep)):
  brep = Rhino.RhinoDoc.ActiveDoc.Objects.AddBrep(Brep[q], Rhino.DocObjects.ObjectAttributes())  
  x,y,z = Rhino.Geometry.AreaMassProperties.Compute(Brep[q]).Centroid
  print (str(x) + "," + str(y) + "," + str(z))
  rs.Command("SelLast")
  rs.Command("-Export " + "C:\\Users\\User\\Documents\\" + str(q) + ".fbx Enter Enter Enter") 
  #y=n turns off silly Y/Z axis swap! Use no spaces in the file path.
  fileName = "C:\\Users\\User\\Documents\\" + str(q) + ".coordinates"
  try:
    os.remove(fileName)
  except OSError:
    pass
  f = open(fileName,"w")
  f.write(str(x) + "," + str(y) + "," + str(z))
  f.close()
#  rs.Command("SelID " + str(brep) + " Enter")
#  rs.Command("Delete Enter")
  
rs.Command("SelAll Hide Enter")
# ---------- end python_nik_s_obj_file_saver ----------
bang = ExplodeTree(Data=panel)  # -> Branch0, Branch1, Branch2, Branch3, Branch4, Branch5, Branch6, Branch7, Branch8, Branch9
number_slider = Slider(1, range=0..1)
panel_2 = Panel(python_nik_s_obj_file_saver)
volume = Volume(Geometry=brep)  # -> Volume, Centroid
panel_3 = Panel(csv.Headers)
vec = VectorXYZ(XComponent=0, YComponent=0, ZComponent=number_slider)  # -> Vector, Length
vec_2 = VectorXYZ(XComponent=bang.Branch1, YComponent=bang.Branch2, ZComponent=bang.Branch3)  # -> Vector, Length
roz = Number(bang.Branch6)
python_nik_s_obj_file_saver_2 = PythonScript()  # -> out; inputs Brep: list of Brep
# ---------- python_nik_s_obj_file_saver_2: Python ----------
import rhinoscriptsyntax as rs
import Rhino
import os

print "Brep size : " + str(len(Brep))
for q in range (0,len(Brep)):
  brep = Rhino.RhinoDoc.ActiveDoc.Objects.AddBrep(Brep[q], Rhino.DocObjects.ObjectAttributes())  
  x,y,z = Rhino.Geometry.AreaMassProperties.Compute(Brep[q]).Centroid
  print (str(x) + "," + str(y) + "," + str(z))
  rs.Command("SelID " + str(brep) + " Enter")
  rs.Command("-Export " + "C:\\Users\\User\\Documents\\" + str(q) + ".fbx _Save_Textures=No y=n Enter Enter Enter") 
  #y=n turns off silly Y/Z axis swap! Use no spaces in the file path.
  fileName = "C:\\Users\\User\\Documents\\" + str(q) + ".coordinates"
  try:
    os.remove(fileName)
  except OSError:
    pass
  f = open(fileName,"w")
  f.write(str(x) + "," + str(y) + "," + str(z))
  f.close()
  
rs.Command("SelAll Delete Enter")
# ---------- end python_nik_s_obj_file_saver_2 ----------
move = Move(Geometry=brep, Motion=vec_2.Vector)  # -> Geometry, Transform
rot3d = Rotate3D(Geometry=move.Geometry, Angle=roz, Center=volume.Centroid, Axis=vec.Vector)  # -> Geometry, Transform
vec_3 = VectorXYZ(XComponent=0, YComponent=number_slider, ZComponent=0)  # -> Vector, Length
roy = Number(bang.Branch5)
rot3d_2 = Rotate3D(Geometry=rot3d.Geometry, Angle=roy, Center=volume.Centroid, Axis=vec_3.Vector)  # -> Geometry, Transform
panel_4 = Panel(python_nik_s_obj_file_saver_2)
vec_4 = VectorXYZ(XComponent=number_slider, YComponent=0, ZComponent=0)  # -> Vector, Length
rox = Number(bang.Branch4)
rot3d_3 = Rotate3D(Geometry=rot3d_2.Geometry, Angle=rox, Center=volume.Centroid, Axis=vec_4.Vector)  # -> Geometry, Transform
scale_nu = ScaleNU(Geometry=rot3d_3.Geometry, Plane=volume.Centroid, ScaleX=bang.Branch7, ScaleY=bang.Branch8, ScaleZ=bang.Branch9)  # -> Geometry, Transform
